# Grasshopper definition hbph_installer.gh (Grasshopper 1.0.8)

# ---- group: Set me to 'True' to download and install
toggle = BooleanToggle(False)

# ----
# JUN. 25, 2024 [v1.6.04]
# This installer will add new libraries to the Ladybug Tools python interpreter which is installed on your computer.
# Specifically, it will:
# - Download and add a new ‘Honeybee-PH’ plugin to your Ladybug Tools installation.
# - Download and add a new ‘PHX’ plugin to your Ladybug Tools installation.
# - Download and add a new library for read/write to excel (XLWings) to your Ladybug Tools installation.
# - Download and add new Grasshopper Components to your Grasshopper ‘User Objects’ folder which will then be available
# for use in your Grasshopper environment
# 
# NOTE: The Honeybee-PH Plugin is currently compatible with Ladybug Tools version v1.7.26 or newer only.
# Please update your Ladybug Tools version using the “LB Versioner” grasshopper component  BEFORE installing Honeybee-PH
# Once installed, please reboot Rhino for the new plugins to become available.
# You no longer need this .GH file, and can safely discard it once you have completed the install steps above.
# If you run this again in the future, this installer will overwrite any existing Honeybee-PH installation with the latest version.
panel = Panel("1.28.15")
hbphinstall = HBPHInstaller(install=toggle, hbph_version=panel, phx_version="1.47.4")  # -> out
# ---------- hbphinstall: Python ----------
#
# Honeybee-PH: A Plugin for adding Passive-House data to LadybugTools Honeybee-Energy Models
# 
# This component is part of the PH-Tools toolkit <https://github.com/PH-Tools>.
# 
# Copyright (c) 2022, PH-Tools and bldgtyp, llc <phtools@bldgtyp.com> 
# Honeybee-PH is free software; you can redistribute it and/or modify 
# it under the terms of the GNU General Public License as published 
# by the Free Software Foundation; either version 3 of the License, 
# or (at your option) any later version. 
# 
# Honeybee-PH is distributed in the hope that it will be useful,
# but WITHOUT ANY WARRANTY; without even the implied warranty of 
# MERCHANTABILITY or FITNESS FOR A PARTICULAR PURPOSE. See the 
# GNU General Public License for more details.
# 
# For a copy of the GNU General Public License
# see <https://github.com/PH-Tools/honeybee_ph/blob/main/LICENSE>.
# 
# @license GPL-3.0+ <http://spdx.org/licenses/GPL-3.0+>
#
"""
This component installs/updates all of the 'Honeybee-PH' plugin libraries for Ladybug Tools.
Please make sure that you have Ladybug-Tools with Honeybee-Energy ALREADY fully installed BEFORE
proceeding with this installation. Make sure you are connected to the internet in 
order to download the latest version of the plugin libraries and components.
-
This tool will download and install several new libraries into the Ladybug-Tools
python interpreter, and will download and install new Grasshopper components which
will be added to your Rhino / Grasshopper installation.
-
EM January 25, 2024
    Args:
        _install: (bool) Set to True to install Honeybee-PH on your computer.
        
        _require_admin: (bool) Set FALSE if you KNOW that you need to install HBPH without
            admin. Default=TRUE. In almost all cases, leave this set to TRUE unless you
            are absolutely certain and know what you are doing.
        
        _hbph_branch: (str) Default='main' Optional GitHub repo branch name for
            the honeybee-ph package to install (https://github.com/PH-Tools/honeybee_ph).
            If None is specified, will install the 'main' branch of the repo. If you don't 
            know what branch or package you want, leave this input empty and the 
            default will be installed.
        
        _hbph_gh_branch: (str) Default='main' Optional GitHub repo branch name for
            the honeybee-grasshopper-ph package to install (https://github.com/PH-Tools/honeybee_grasshopper_ph).
            If None is specified, will install the 'main' branch of the repo. If you don't 
            know what branch or package you want, leave this input empty and the 
            default will be installed.
        
        _phx_branch: (str) Default='main' Optional GitHub repo branch name for
            the PHX (Passive House Exchange) package to install (https://github.com/PH-Tools/PHX).
            If None is specified, will install the 'main' branch of the repo. If you don't 
            know what branch or package you want, leave this input empty and the 
            default will be installed.
            
        _hbph_ver: (str): The Version number of the Honeybee-PH package to install from PyPi.
            Note that if you leave this input empty, the latest version will be installed. For 
            more details on honeybee-ph version, see https://pypi.org/project/honeybee-ph/
       
        _phx_ver: (str): The Version number of the PHX package to install from PyPi.
            Note that if you leave this input empty, the latest version will be installed. For 
            more details on honeybee-ph version, see https://pypi.org/project/PHX/
"""

COMPONENT = ghenv.Component # type: ignore
COMPONENT.Name = 'HBPH Installer'
COMPONENT.NickName = 'HBPHInstall'
COMPONENT.Message = 'JAN_25_2024'
COMPONENT.Category = 'Honeybee-PH'
COMPONENT.SubCategory = '00 | Utils'
COMPONENT.AdditionalHelpFromDocStrings = '0'
try:
    COMPONENT.ToggleObsolete(False)
except AttributeError:
    pass # Rhino 7

# -- Required Versions
MIN_VER_RHINO = (7, 18)
MIN_VER_LBT_GH = (1, 7, 26)

import os
import sys
import json
import subprocess

try:
    import ctypes
except:
    pass # MacOs

try:
    from typing import Optional, Tuple
except ImportError:
    pass # IronPython 2.7

try:
    from exceptions import IOError # type: ignore
except ImportError:
    pass # IronPython 2.7

try:
    import Rhino # type: ignore
except ImportError:
    pass # Outside Rhino/Grasshopper

try:
    from Grasshopper.Folders import UserObjectFolders # type: ignore
except ImportError:
    pass # Outside Rhino/Grasshopper

try:
    #from ladybug_rhino.versioning import change
    from ladybug_rhino import grasshopper as lbt_gh
    from ladybug_rhino.config import folders as lbr_folders
    lbr_loaded = True
except ImportError as e:
    lbr_loaded = False
    msg =   '\nFailed to import ladybug_rhino:\n'\
            'Please make sure Ladybug and Honeybee are installed properly before proceeding.\n\t{}'.format(e)
    raise ImportError(msg)

try:
    from ladybug import futil
except ImportError as e:
    msg =   '\nFailed to import ladybug.futil:\n'\
            'Please make sure Ladybug and Honeybee are installed properly before proceeding.\n\t{}'.format(e)
    raise ImportError(msg)

try:
    from honeybee.config import folders as hb_folders
except ImportError as e:
    msg =   '\nFailed to import honeybee.config.folders:\n'\
            'Please make sure Ladybug and Honeybee are installed properly before proceeding.\n\t{}'.format(e)
    raise ImportError(msg)


# -- Required for Rhino 8, otherwise the new py3.9 hijacks the pip install
CUSTOM_ENV = os.environ.copy()
CUSTOM_ENV['PYTHONHOME'] = ''

def require_admin(_component_input):
    # type: (Optional[bool]) -> bool
    """There may be cases where the user wants to install WITHOUT admin."""
    if _component_input is not None:
        return _component_input
    else:
        return True

def is_windows_user_admin():
    # type: () -> bool
    """For Windows only, return True if the user opened Rhino 'As Administrator' and False if not."""
    if (os.name != 'nt'): # In case used on MacOs
        return True
    
    try:
        mode = ctypes.windll.shell32.IsUserAnAdmin() != 0
    except Exception as e:
        raise Exception(e)
    
    if mode != 0:
        return True
    else:
        return False

def check_rhino_version_compatibility(_min_version_allowed):
    # type: (Tuple[int, int]) -> bool
    """Return True if the current Rhino version meets the minimum compatibility requirements.
    
    Arguments:
    ----------
        * _min_version_allowed (Tuple[int, int]): The Minimum Rhino version compatible
            with Honeybee-PH. 
    
    Returns:
    --------
        * (bool)
    """
    
    # -- Only check against Major / Minor version
    rh_min_version_allowed = (_min_version_allowed[0], _min_version_allowed[1])
    rh_version_found = (Rhino.RhinoApp.Version.Major, Rhino.RhinoApp.Version.Minor)

    if rh_version_found > rh_min_version_allowed:
        print ("Rhino version: {}.{} found.".format(Rhino.RhinoApp.Version.Major, Rhino.RhinoApp.Version.Minor))
        return True
    
    msg = "Error: Honeybee-PH requires Rhino version: "\
        "{}.{} or better. Please update Rhino before proceeding. "\
        "Got version: {}.{}".format(
            _min_version_allowed[0],
            _min_version_allowed[1],
            Rhino.RhinoApp.Version.Major,
            Rhino.RhinoApp.Version.Minor,
        )
    print(msg)
    raise Exception(msg)

def check_LBT_GH_version_compatibility(_min_version_allowed):
    # type: (Tuple[int, int, int]) -> bool
    """Return True if the installed LBT Grasshopper version meets the minimum compatibility requirements.
    
    Arguments:
    ----------
        * _min_version_allowed (Tuple[int, int]): The Minimum Ladybug Grasshopper version compatible
            with Honeybee-PH. 
    
    Returns:
    --------
        * (bool)
    """
    # ---------------------------------------------------------------------------
    lbt_gh = lbr_folders.lbt_grasshopper_version
    if not lbt_gh:
        msg = (
            "Error: Please make sure that you have Ladybug Tools and Honeybee installed "
            "before proceeding with the installation. \n"
            "Cannot determine the Ladybug Tools version installed? \n"
            " - ladybug_rhino.config.lbt_grasshopper_version={} \n".format(lbt_gh)
            )
        raise Exception(msg)
    
    # ---------------------------------------------------------------------------
    print("LBT Grasshopper version: {}.{}.{} found.".format(*lbt_gh))
    print("- "*25)
    
    # ---------------------------------------------------------------------------
    if lbt_gh < _min_version_allowed:
        msg = "\nError: Honeybee-PH is not "\
            "compatible with the version of Ladybug Tools installed on this computer [v{}]. Honeybee-PH requires "\
            "at least LadybugTools v{} in order to work properly. Please "\
            "update your Ladybug Tools installation to a compatible version before proceeding "\
            "with the Honeybee-PH installation. You can use the Ladybug 'LB Versioner' component to update "\
            "your Honeybee installation, and then restart Rhino before trying to install Honeybee-PH again."\
            "Note that you may be required to run the 'LB Versioner' more than once if you have a very old "\
            "version of Ladybug Tools installed.".format(lbt_gh, _min_version_allowed)
        raise Exception(msg)
    
    return True

def update_libraries_pip(python_exe, package_name, version=None, target=None, _env=None):
    # type: (str, str, str, str, Optional[Dict]) -> str
    """Update/Install Python libraries using pip.
    
    Args:
        python_exe: The path to the Python executable to be used for installation.
        package_name: The name of the PyPI package to install
        version: An optional string for the version of the package to install.
        target: An optional target directory into which the package will be installed.
        _env: The OS Environment to be used for the Pip-Install
    Returns:
        error_msg (str)
    """
    
    # Set the environment for pip install to fix Rhino-8 issues
    if _env == None:
        _env = os.environ
        
    # build up the command using the inputs
    if version is not None:
            package_name = '{}=={}'.format(package_name, version)
    
    cmds = [python_exe, '-m', 'pip', 'install', package_name]
    
    if version is None:
        cmds.append('-U')
    
    if target is not None:
        cmds.extend(['--target', target, '--upgrade'])

    # execute the command and print any errors
    print('Installing "{}" version via pip'.format(package_name))
    
    use_shell = True if os.name == 'nt' else False
    
    # Use the ENV passed in to fix any Rhino-8 issues
    process = subprocess.Popen(
        cmds, shell=use_shell, stdout=subprocess.PIPE, stderr=subprocess.PIPE, env=_env)
    
    output = process.communicate()
    
    stdout, stderr = output
    
    error_msg = 'Package "{}" may not have been updated correctly\n' \
        'or its usage in the plugin may have changed. See pip stderr below:\n' \
        '{}'.format(package_name, stderr)
    
    return error_msg

def pip_install(_package_name, _package_version, _lbt_python_exe_path, _lbt_python_package_path, _package_install_folder_name=None, _env=None):
    # type: (str, Optional[str], str, str, Optional[str], Optional[Dict]) -> None
    """PIP install a specified package from PyPi to the Ladybug Tools Python.
    
    Arguments:
    ----------
        * _package_name (str): The name of the package to install from PyPi
        * _package_version: (Optional[str]) The version of the package to install.
            If None, the most recent version is installed.
        * _lbt_python_exe_path (str): The path to the Ladybug Tools python installation.
        * _lbt_python_package_path (str): The path to the Ladybug Tools python site-packages directory.
        * _package_install_folder_name (Optional[str]): An optional folder name for 
            the package once it is installed. This is used to verify installation went
            correctly. Note that in many cases the install folder name will be 
            different than the package name (ie: "honeybee-ph" --> "honeybee_ph"). If None
            is supplied, will try and automatically create the folder name by replacing all
            hyphens with underscores.
        * _env: The OS Environment to use for the Pip-Install
    Returns:
    --------
        * None
    """
    
    # Set the environment for pip install to fix Rhino-8 issues
    if _env == None:
        _env = os.environ
    
    if not _package_install_folder_name:
        _package_install_folder_name = _package_name.replace("-", "_")
    
    package_dist_folder_name = "{}-{}.dist-info".format(_package_install_folder_name, _package_version)
    package_dist_folder_path = os.path.join(_lbt_python_package_path, package_dist_folder_name)
    
    print('- '*25)
    print('Installing Python package: {} (v{}) to: {}'.format(_package_name, _package_version, _lbt_python_package_path))
    stderr = update_libraries_pip(_lbt_python_exe_path, _package_name, _package_version, _env=_env)
    package_install_folder = os.path.join(_package_install_folder_name, package_dist_folder_name)
    
    if os.path.isdir(package_dist_folder_path):
        print("Package '{}' (v-{}) successfully installed to: {}".format(_package_name, _package_version, _lbt_python_package_path))
    else:
        print("Could not find {}".format(package_dist_folder_path))
        print("Package '{}' (v-{}) failed to install to: {}".format(_package_name, _package_version, _lbt_python_package_path))
        lbt_gh.give_warning(COMPONENT, stderr)
        print(stderr)

def copy_repo_contents_to_site_packages(_source_directory, _target_directory, _branch):
    # type: (str, str, str) -> None
    """Copy a directory's contents to the Ladybug Tools site-packages directory.
    
    Arguments:
    ----------
        * _source_directory (str): The full path to the directory to copy the contents of.
        * _target_directory (str): The full path to the directory to copy to.
    
    Returns:
    --------
        * None
    """
    
    directories_to_exclude = {'.github', 'tests', 'docs', 'diagrams',} 
    for _dir in os.listdir(_source_directory):
        src_dir = os.path.join(_source_directory, _dir)
        
        if _dir in directories_to_exclude: # don't copy any of these to site-packages
            continue
        
        if not os.path.isdir(src_dir): # If the target folder doesn't exist already
            continue
        
        print('Copying "{}" to:: {}'.format(_dir, _target_directory))
        futil.copy_file_tree(src_dir, os.path.join(_target_directory, _dir))

def get_files_from_github_repo(_github_repo_name, _target_directory, _branch='main'):
    # type: (str, str, str) -> None
    """Download, unzip and copy files from a GitHub repo into a target directory.
    
    Arguments:
    ----------
        * _github_repo_name (str): The name of the GitHub repo to download.
        * _target_directory (str): The full path of the directory to put the
            downloaded files in.
        * _branch (str): default='main' The target branch name to download.
    
    Returns:
    --------
        * None
    """

    # -------------------------------------------------------------------------
    # -- Setup all the file and directory paths
    github_url = "https://github.com/PH-Tools/{}/archive/refs/heads/{}.zip".format(_github_repo_name, _branch)
    directory_to_download_to = hb_folders.python_package_path
    name_of_zipfile_to_download = '{}.zip'.format(_github_repo_name)
    downloaded_zip_file_path = os.path.join(directory_to_download_to, name_of_zipfile_to_download)
    temp_unzip_directory = os.path.join(directory_to_download_to, "{}-{}".format(_github_repo_name, _branch))
    
    # -------------------------------------------------------------------------
    #-- Try and download the Github Repo as a .zip file, then unzip the file
    try:
        print("- "*25)
        print("Downloading:: {}\nto:: {}".format(github_url, downloaded_zip_file_path))
        futil.download_file_by_name(github_url, directory_to_download_to, name_of_zipfile_to_download, mkdir=True)
        
        print("Unzipping:: {}\nto:: {}/".format(downloaded_zip_file_path, temp_unzip_directory))
        futil.unzip_file(downloaded_zip_file_path, directory_to_download_to, mkdir=True)
    except IOError as e:
        msg = (
            "There was an error downloading the {} package to your computer.\n"
            "If you have Ladybug Tools installed in you 'ProgramFiles' directory, (ie: if you "
            "are using Pollination instead of the Food4Rhino LBT installer) you may \n"
            "need to run Rhino 'as administrator' in order to "
            "install to this directory?\n".format(_github_repo_name)
            )
        raise IOError(msg)
    except Exception as e:
        msg = "There was a error downloading {} to {} and unzipping the file "\
            "to {}.\n{}".format(github_url, downloaded_zip_file_path, temp_unzip_directory, e)
        raise Exception(msg)


    # -------------------------------------------------------------------------
    # -- Copy the unzipped files/folders over to the Ladybug site-packages folder
    copy_repo_contents_to_site_packages(temp_unzip_directory, _target_directory, _branch)
    
    
    # -------------------------------------------------------------------------
    # -- Cleanup: Remove the downloaded folder and zip file
    print("Removing directory: {}".format(temp_unzip_directory))
    futil.nukedir(temp_unzip_directory, True)

    print("Removing downloaded file: {}".format(downloaded_zip_file_path))
    os.remove(downloaded_zip_file_path)

def copy_grasshopper_components_to_UserObjects(_repo_name, _download_directory, _target_directory):
    # type: (str, str, str) -> None
    """Copy all of the GH-User objects from the source dir over the Grasshopper UserObjects directory. 

    This is used when downloading from the "honeybee_grasshopper_ph" github repo, since the .ghuser objects 
    are nested down in the unzipped directory. This function should get called after download and unzip from 
    the "honeybee_grasshopper_ph" github repo.
    
    Arguments:
    ---------- 
        * _repo_name (str): The name of the honeybee_grasshopper_ph repo.
        * _download_directory (str): The path to the download directory.
        * _target_directory (str): The Grasshopper UserObjects directory to copy to .ghuser files to.
    
    Returns:
    --------
        * None
    """
    
    repo_download_directory = os.path.join(_download_directory, _repo_name)
    hbph_gh_source_folder = os.path.join(repo_download_directory, 'user_objects')
    
    if not os.path.isdir(hbph_gh_source_folder):
        msg = (
            "Cannot find the Grasshopper Component directory: {}? Please be sure"
            "you downloaded and unzipped the '{}' GitHub repo before trying to copy to"
            "the Grasshopper UserObjects directory".format(hbph_gh_source_folder, _repo_name)
        )
        print(msg)
        return
    
    target = os.path.join(_target_directory[0], _repo_name)
    
    # -- Clean out any existing files in the target directory.
    if os.path.exists(target):
        for file_name in os.listdir(target):
            file_path = os.path.join(target, file_name)
            try:
                if os.path.isfile(file_path):
                    os.unlink(file_path)
                elif os.path.isdir(file_path):
                    shutil.rmtree(file_path)
            except Exception as e:
                print("Error deleting file or directory: {}".format(e))

    print('- '*25)
    print('Copying Grasshopper Components from::\n{} to::\n{}'.format(hbph_gh_source_folder, target))
    
    futil.copy_file_tree(hbph_gh_source_folder, target, overwrite=True)
    
    print("Removing directory: {}".format(repo_download_directory))
    futil.nukedir(repo_download_directory, True)

def install_from_GitHub(_hbph_branch, _phx_branch, _hbph_gh_branch, _rich_version, _xlwings_version, _lbt_python_exe_path, _lbt_python_package_path):
    # type: (Optional[str], Optional[str], Optional[str], Optional[str], Optional[str], str, str) -> None
    """Download all the files directly from the GitHub repositories into the Ladybug Python site-packages.
    
    Arguments:
    ----------
        * _hbph_branch (Optional[str]): The name of the 'honeybee_ph' Github branch to 
            install. If None, 'main' will be used.
        * _phx_branch (Optional[str]): The name of the 'phx' Github branch to 
            install. If None, 'main' will be used.
        * _hbph_gh_branch (Optional[str]): The name of the 'honeybee_grasshopper_ph' Github branch to 
            install. If None, 'main' will be used.
        * _rich_version (Optional[str]): The version of Rich to install from PyPi. If None
            is supplied, will install the most recent version.
        * _xlwings_version (Optional[str]): The version of XLWings to install from PyPi. If None
            is supplied, will install the most recent version.
        * _lbt_python_exe_path (str): The path to the Ladybug Tools python.exe
        * _lbt_python_package_path (str): The path to the Ladybug Tools python site-packages directory.
    
    Returns:
    --------
        * None
    """

    # -- In this case, also Pip install the XLWings and Rich dependencies
    # -------------------------------------------------------------------------
    pip_install('rich', _rich_version, _lbt_python_exe_path, _lbt_python_package_path)
    pip_install('xlwings', _xlwings_version, _lbt_python_exe_path, _lbt_python_package_path)

    # -- Get the Honeybee-PH and PHX from GitHub
    # -------------------------------------------------------------------------
    get_files_from_github_repo('honeybee_ph', hb_folders.python_package_path, _hbph_branch or 'main')
    get_files_from_github_repo('PHX', hb_folders.python_package_path, _phx_branch or 'main')

    # -- Get the Honeybee-PH Grasshopper Components from GitHub
    # -------------------------------------------------------------------------
    get_files_from_github_repo('honeybee_grasshopper_ph', hb_folders.python_package_path, 'main')
    copy_grasshopper_components_to_UserObjects('honeybee_grasshopper_ph', hb_folders.python_package_path, UserObjectFolders)

    # -- Get the Honeybee-PH+ Grasshopper Components from GitHub
    # -------------------------------------------------------------------------
    get_files_from_github_repo('honeybee_grasshopper_ph_plus', hb_folders.python_package_path, 'main')
    copy_grasshopper_components_to_UserObjects('honeybee_grasshopper_ph_plus', hb_folders.python_package_path, UserObjectFolders)

    # -------------------------------------------------------------------------
    # -- Give a success message
    success_msg = 'Honeybee-PH has been successfully installed'
    restart_msg = 'RESTART RHINO to load the new components + library.'
    for msg in (success_msg, restart_msg):
        print(msg)
    lbt_gh.give_popup_message('\n'.join([success_msg, restart_msg]), 'Installation Successful!')
    return

def update_pip(python_exe, _env=None):
    # type: (str, Optional[Dict]) -> str
    """Update 'Pip' to avoid seeing those error.
    
    Args:
        _env: The OS Environment to be used for the Pip-Install
    Returns:
        error_msg (str)
    """
    
    # Set the environment for pip install to fix Rhino-8 issues
    if _env == None:
        _env = os.environ
        
    # build up the command using the inputs
    cmds = [python_exe, '-m', 'pip', 'install', '--upgrade', 'pip']
    
    # execute the command and print any errors
    print('Updating Pip...')
    
    use_shell = True if os.name == 'nt' else False
    
    # Use the ENV passed in to fix any Rhino-8 issues
    try:
        process = subprocess.Popen(
            cmds, shell=use_shell, stdout=subprocess.PIPE, stderr=subprocess.PIPE, env=_env)
        
        output = process.communicate()
        
        stdout, stderr = output
        
        error_msg = 'Command: {} may have failed for some reason'.format(cmds)
    except Exception as e:
        error_msg = e

    return error_msg

def install_from_PyPi(_hbph_version, _phx_version, _hbph_gh_branch, _lbt_python_exe_path, _lbt_python_package_path, _env=None):
    # type: (Optional[str], Optional[str], Optional[str], str, str, Optional[Dict]) -> None
    """Install Honeybee-PH and PHX Packages from PIP, download Grasshopper components from Github.
    
    Arguments:
    ----------
        * _hbph_version (Optional[str]): The Honeybee-PH version to install from PyPi. If
            None is supplied, will install the most recent.
        * _phx_version (Optional[str]): The PHX version to install from PyPi. If
            None is supplied, will install the most recent.
        * _hbph_gh_branch (Optional[str]): The name of the 'honeybee_grasshopper_ph' Github branch to 
            install. If None is supplied, 'main' will be used.
        * _lbt_python_exe_path (str): The path to the Ladybug Tools python.exe
        * _lbt_python_package_path (str): The path to the Ladybug Tools python site-packages directory.
        * _env: The os.environ dict to use for pip-install
    
    Returns:
    --------
        * None
    """
    
    # Set the environment for pip install to fix Rhino-8 issues
    if _env == None:
        _env = os.environ
    
    # -------------------------------------------------------------------------
    # Install the Honeybee-PH and PHX packages from PyPi
    #update_pip(_lbt_python_exe_path, _env=_env)
    pip_install('honeybee-ph', _hbph_version, _lbt_python_exe_path, _lbt_python_package_path, _env=_env)
    pip_install('phx', _phx_version, _lbt_python_exe_path, _lbt_python_package_path, _env=_env)
    
    # -------------------------------------------------------------------------
    # -- Install the Honeybee-PH Grasshopper Components and Libraries from GitHub
    get_files_from_github_repo('honeybee_grasshopper_ph', hb_folders.python_package_path, _hbph_gh_branch or 'main')
    copy_grasshopper_components_to_UserObjects('honeybee_grasshopper_ph', hb_folders.python_package_path, UserObjectFolders)
    
    # -------------------------------------------------------------------------
    # -- Install the Honeybee-PH+ Grasshopper Components and Libraries from GitHub
    get_files_from_github_repo('honeybee_grasshopper_ph_plus', hb_folders.python_package_path, _hbph_gh_branch or 'main')
    copy_grasshopper_components_to_UserObjects('honeybee_grasshopper_ph_plus', hb_folders.python_package_path, UserObjectFolders)
    
    # -------------------------------------------------------------------------
    # Give a success message
    success_msg = 'Honeybee-PH and PHX have been successfully installed!'
    restart_msg = 'RESTART RHINO to load the new components + libraries.'
    for msg in (success_msg, restart_msg):
        print(msg)
    lbt_gh.give_popup_message('\n'.join([success_msg, restart_msg]), 'Installation Successful!')
    return

def install_honeybee_ph(_install, _hbph_branch, _hbph_gh_branch, _phx_branch, _hbph_version, _phx_version, _min_ver_rhino, _min_ver_lbt_gh, _require_admin, _env=None):
    # type: (bool, Optional[str], Optional[str], Optional[str], Optional[str], Optional[str], Tuple[int, int], Tuple[int, int, int], bool, Optional[Dict]) -> None
    """Install the Honeybee-PH plugin.
    
    Arguments:
    ----------
        * _install (bool): Set True to run the installer. 
        * _hbph_branch (Optional[str]): The name of the GitHub branch to install (ie: 'main').
        * _hbph_gh_branch (Optional[str]): The name of the GitHub branch to install (ie: 'main').
        * _phx_branch (Optional[str]): The name of the GitHub branch to install (ie: 'main').
        * _hbph_version (Optional[str]): The version number of Honeybee-PH to install from PyPi.
        * _phx_version (Optional[str]): The version number of PHX to install from PyPi.
        * _min_ver_rhino (Tuple[int, int]):
        * _min_ver_lbt_gh (Tuple[int, int, int]):
        * _require_admin (bool):
        * _env: The os.environ dict to use for pip-install
    
    Returns:
    --------
        * None
    """
    
    # Set the environment for pip install to fix Rhino-8 issues
    if _env == None:
        _env = os.environ
    
    # -------------------------------------------------------------------------
    # -- Check version compatibility
    check_rhino_version_compatibility(_min_ver_rhino)
    check_LBT_GH_version_compatibility(_min_ver_lbt_gh)

    # -------------------------------------------------------------------------
    # -- Check to make sure the user has admin rights, otherwise PyPi will silently
    # -- fall back to other python installations on the user' computer, which will mess 
    # -- up all sorts of things. This error should be raised BEFORE any installation 
    # -- to ensure that nothing gets mistakenly installed elsewhere on the user's system.
    if _require_admin:
        if not is_windows_user_admin():
            msg = "Warning: You must have 'Admin' privileges on this computer in order "\
                "to properly install Honeybee-PH. Try restarting Rhino using "\
                "'Run as administrator' before proceeding."
            raise Exception(msg)
    else:
        msg = "Note: You have chosen to install WITHOUT admin privledges. This may cause "\
            "HBPH to be installed in an unexpected location on your system? If you don't "\
            "know where you want your HBPH installed, leave '_require_admin' set to TRUE"
        print msg
    
    # -------------------------------------------------------------------------    
    if any((_hbph_branch, _phx_branch, _hbph_gh_branch)):
        # -- If the user supplies any GitHub branch name, use the GitHub versions for all.
        # -- In this case, supply the dependency versions to install as well (since no PIP resolution)
        rich_version = None # None=defaults to newest
        xlwings_version = None # None=defaults to newest
        install_from_GitHub(
                        _hbph_branch,
                        _phx_branch,
                        _hbph_gh_branch,
                        rich_version,
                        xlwings_version, 
                        hb_folders.python_exe_path,
                        hb_folders.python_package_path,
                        )
        return
    else:
        # -- Otherwise, just install everything from PyPi
        install_from_PyPi(  _hbph_version,
                            _phx_version,
                            _hbph_gh_branch, 
                            hb_folders.python_exe_path,
                            hb_folders.python_package_path,
                            _env=_env
                        )
        return


# ---
admin = require_admin(_require_admin)

# ---
if _install:
    install_honeybee_ph(_install, _hbph_branch, _hbph_gh_branch, _phx_branch,
                        _hbph_version, _phx_version, MIN_VER_RHINO,
                        MIN_VER_LBT_GH, admin, CUSTOM_ENV)
else:
    msg = 'Please:\n'\
    '- Be sure you have already installed Ladybug Tools.\n'\
    '- Are connected to the internet.\n'\
    '- Set _install to "True" to install Honeybee-PH and all dependencies on this system.'   
    print(msg)
# ---------- end hbphinstall ----------
panel_2 = Panel(hbphinstall)
